# Grasshopper definition process_trees.gh (Grasshopper 1.0.7)
# plug-ins: Mesh Pipe

# ----
# Canvas colours
boolean_toggle = BooleanToggle(False)
canvas_colours = PythonScript(
    Monochrome=boolean_toggle,
    CanvasColour=ColourSwatch(SwatchColor=RGB(255, 255, 255)),
    CanvasEdge=ColourSwatch(SwatchColor=RGB(0, 0, 0)),
    Shade=ColourSwatch(SwatchColor=RGBA(255, 255, 255, 0)),
    Grid=ColourSwatch(SwatchColor=RGBA(0, 0, 0, 0)))  # inputs Monochrome: Boolean, CanvasColour: Color, CanvasEdge: Color
# ---------- canvas_colours: Python ----------
import Grasshopper as gh

# Set background colour
gh.GUI.Canvas.GH_Skin.canvas_mono = Monochrome
if Monochrome:
    gh.GUI.Canvas.GH_Skin.canvas_mono_color = CanvasColour
else:
    gh.GUI.Canvas.GH_Skin.canvas_back = CanvasColour

# Other effects
gh.GUI.Canvas.GH_Skin.canvas_shade = Shade
gh.GUI.Canvas.GH_Skin.canvas_edge = CanvasEdge
gh.GUI.Canvas.GH_Skin.canvas_grid = Grid
# ---------- end canvas_colours ----------

trees = Mesh([<mesh referenced from the Rhino model> x5000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])
tin = Mesh(<mesh referenced from the Rhino model>)
check_closed = GhPythonScript(mesh=trees)  # -> mesh; inputs mesh: list of Mesh
# ---------- check_closed: Python ----------
import Rhino.Geometry as rg

mesh = [m for m in mesh if not m.IsClosed]
# ---------- end check_closed ----------
check_closed_2 = GhPythonScript(mesh=trees)  # -> mesh; inputs mesh: list of Mesh
# ---------- check_closed_2: Python ----------
import Rhino.Geometry as rg

mesh = [m for m in mesh if m.IsClosed]
# ---------- end check_closed_2 ----------

trees_2 = Mesh(check_closed_2)
tin_2 = Mesh(tin)

volume = Volume(Geometry=trees_2)  # -> Volume, Centroid
mesh_ray = MeshRay(Mesh=trees_2, Point=volume.Centroid, Direction=Vector(0, 0, -1))  # -> Point, Hit
expression = Expression(volume=volume.Volume, Expression="volume^(0.15)/4")
mesh_ray_2 = MeshRay(Mesh=tin_2, Point=volume.Centroid, Direction=Vector(0, 0, -1))  # -> Point, Hit
line = Line(StartPoint=mesh_ray.Point, EndPoint=mesh_ray_2.Point)
mesh_pipe = MeshPipe(Curve=line, Radius=expression, Accuracy=0.2, Rotation=0, Segments=6, Caps=1)
null_item = NullItem(Item=mesh_pipe)  # -> NullFlags, InvalidFlags, Description
cull_pattern = CullPattern(List=trees_2, CullPattern=invert(null_item.NullFlags))
cull_pattern_2 = CullPattern(List=mesh_pipe, CullPattern=invert(null_item.NullFlags))

tree_trunks = Mesh(cull_pattern_2)
trees_3 = Mesh(cull_pattern)

tree_trunks_2 = Mesh(cull_pattern_2)
trees_4 = Mesh(cull_pattern)
tin_3 = Mesh(tin)
custom_preview = CustomPreview(Geometry=tree_trunks_2, Material=ColourSwatch(SwatchColor=RGB(112, 86, 58)))
custom_preview_2 = CustomPreview(Geometry=trees_4, Material=ColourSwatch(SwatchColor=RGB(145, 184, 86)))
custom_preview_3 = CustomPreview(Geometry=tin_3, Material=ColourSwatch(SwatchColor=RGB(222, 232, 172)))

ghpython_script = GhPythonScript(crowns=trees_3, trunks=tree_trunks)  # -> out, path; inputs crowns: list of Mesh, trunks: list of Mesh
# ---------- ghpython_script: Python ----------
import Rhino.Geometry as rg
import os
import uuid
import json
from json import encoder
encoder.FLOAT_REPR = lambda o: format(o, '.1f') # globally format json floats

j = {
"type": "CityJSON",
"version": "1.0",
"CityObjects": {},
"vertices": []
}

def mesh_to_obj(mesh, index_offset):
    surface = [[[ v+index_offset for v in list(f)[0:3]]] if f.IsTriangle
               else [[ v+index_offset for v in list(f)]] for f in mesh.Faces]
    verts = [[float(v.X), float(v.Y), float(v.Z)] for v in mesh.Vertices]
    return surface, verts

vertex_count = 0

for crown, trunk in zip(crowns, trunks):
    id = str(uuid.uuid4())
    crown_surface, crown_verts = mesh_to_obj(crown, vertex_count)
    vertex_count += len(crown_verts)
    trunk_surface, trunk_verts = mesh_to_obj(trunk, vertex_count)
    vertex_count += len(trunk_verts)
    
    cityobj = {
        "type": "SolitaryVegetationObject",
        "geometry": [
            {
                "type": "Solid",
                "lod": 2,
                "boundaries" : [
                    crown_surface
                ]
            },
            {
            "type": "Solid",
                "lod": 2,
                "boundaries" : [
                    trunk_surface,
                ]
            }
        ]
    }
    
    j["CityObjects"][id] = cityobj
    j["vertices"].extend(crown_verts)
    j["vertices"].extend(trunk_verts)


ghpath = ghenv.LocalScope.ghdoc.Path
ghdir = os.path.dirname(ghpath)
path = ghdir + "/../_data/trees/trees_export.json"

with open(path, 'w') as outfile:
    json.dump(j, outfile)
# ---------- end ghpython_script ----------
panel = Panel(ghpython_script.path)
